# Grasshopper definition Auxetic Pattern.gh (Grasshopper 1.0.7)
# plug-ins: Linketix

number_slider = Slider(3, range=1..10)
# Input
number_slider_2 = Slider(10, range=1..10)
pipeline = GeometryPipeline(
    GroupByLayer=False,
    GroupByType=False,
    IncludeHidden=True,
    IncludeLocked=True,
    LayerFilter="Default",
    NameFilter="*",
    SublayerFiltering=True,
    TypeFilter=1073741848)

rectangular_1 = Rectangular1(
    Plane=PlaneXY(0, 0, 0),
    Length=number_slider_2,
    Width=number_slider_2,
    ExtentX=number_slider,
    ExtentY=number_slider,
    Motion=Slider(0, range=0..1))
rectangular_1_2 = Rectangular1(
    Plane=PlaneXY(0, 0, 0),
    Length=number_slider_2,
    Width=number_slider_2,
    ExtentX=number_slider,
    ExtentY=number_slider,
    Motion=0)
crv = Curve(rectangular_1_2)
crv_2 = Curve(rectangular_1)
geo = Geometry(pipeline)
pcen = PolygonCenter(Polyline=crv)  # -> CenterV, CenterE, CenterA
pcen_2 = PolygonCenter(Polyline=crv_2)  # -> CenterV, CenterE, CenterA
bbox = BoundingBox(Content=geo, Plane=PlaneXY(0, 0, 0))  # -> Box, Box_2
area = Area(Geometry=bbox.Box)  # -> Area, Centroid
pl_origin = PlaneOrigin(Base=crv_2, Origin=pcen_2.CenterV)
pl_origin_2 = PlaneOrigin(Base=crv, Origin=pcen.CenterV)
cp = ClosestPoint(Point=area.Centroid, Cloud=pcen.CenterV)  # -> ClosestPoint, CPIndex, Distance
box = CenterBox(Base=pl_origin, X=1, Y=1, Z=1)
box_2 = CenterBox(Base=pl_origin_2, X=1, Y=1, Z=1)
item = ListItem(List=box, Index=cp.CPIndex, Wrap=True)
item_2 = ListItem(List=box_2, Index=cp.CPIndex, Wrap=True)
cluster = Cluster(G=crv_2, A_2=number_slider_2, A=number_slider)
boxmap = BoxMapping(Geometry=geo, Source=item_2, Target=item)  # -> Geometry, Transform
geo_2 = Geometry(boxmap.Geometry)
cluster_2 = Cluster(G=geo_2, A_2=number_slider_2, A=number_slider)

# ----
# Output
swatch = ColourSwatch(SwatchColor=RGB(0, 0, 0))
# Designed By Stepan Drunks
swatch_2 = ColourSwatch(SwatchColor=RGB(255, 0, 0))
preview = CustomPreview(Geometry=[crv, cluster], Material=swatch)
preview_2 = CustomPreview(Geometry=cluster_2, Material=swatch_2)

# ==== cluster Cluster
A = ClusterInput()
multiplication = Multiplication(A=A, B=2)
A_2 = ClusterInput()
multiplication_2 = Multiplication(A=A_2, B=multiplication)
addition = Addition(A=multiplication_2, B=Slider(10, range=1..100))
Y = UnitY(Factor=addition)
G = ClusterInput()
move = Move(Geometry=G, Motion=Y)  # -> Geometry, Transform
G_2 = ClusterOutput(move.Geometry)
